% Simulink data dictionary model4_lin_control_parameters.sldd

lin_current_con_Kp = Simulink.Parameter(2.755)  % Proportional coefficient for current controller
lin_position_con_Kp = Simulink.Parameter(10)  % Proportional coefficient for position controller
lin_current_con_Ki = Simulink.Parameter(2466.2)  % Integral coefficient for current controller
lin_velocity_con_Ki = Simulink.Parameter(20.5)  % Integral coefficient for velocity controller
lin_velocity_con_Kp = Simulink.Parameter(0.0385)  % Proportional coefficient for velocity controller