% Simulink data dictionary model4_lin_general_data.sldd

lin_dc_voltage_source = Simulink.Parameter(36, Unit="V")  % DC Voltage Source
lin_lead = Simulink.Parameter(0.002, Unit="m")  % Screw lead value
lin_gear_ratio = Simulink.Parameter(3.7)  % Gear transmission rate (can be excluded)
lin_screwnut_efficiency = Simulink.Parameter(0.75)  % Screw-nut/Nut-Screw efficiency