% Simulink data dictionary model4_lin_motor_data.sldd

lin_motor_P_pole_pairs = Simulink.Parameter(4)  % Number of pole pairs in linear motor Maxon EC-i (539488)
lin_motor_P_rotorJ = Simulink.Parameter(1.55e-6, Unit="kg*m*m")  % Rotor inertia in linear motor Maxon EC-i (539488)
lin_motor_P_statorLd = Simulink.Parameter(0.0004385, Unit="H")  % Stator d-axis inductance in linear motor Maxon EC-i (539488)
lin_motor_P_statorLq = Simulink.Parameter(0.0004385, Unit="H")  % Stator q-axis inductance in linear motor Maxon EC-i (539488)
lin_motor_P_statorR = Simulink.Parameter(0.3925, Unit="Ω")  % Stator resistance per phase in linear motor Maxon EC-i (539488)
lin_motor_P_torqueK = Simulink.Parameter(0.0429, Unit="N*m/A")  % Torque constant in linear motor Maxon EC-i (539488)