% Simulink data dictionary model4_control_parameters.sldd

current_con_Kp = Simulink.Parameter(1.15)  % Proportional coefficient for current controller
current_con_Ki = Simulink.Parameter(493)  % Integral coefficient for current controller
velocity_con_Kp = Simulink.Parameter(0.5)  % Proportional coefficient for velocity controller
velocity_con_Ki = Simulink.Parameter(20)  % Integral coefficient for velocity controller
position_con_Kp = Simulink.Parameter(10)  % Proportional coefficient for position controller