% Simulink data dictionary model4_general_data.sldd

gearbox_ratio = Simulink.Parameter(67)  % Gearbox transmission rate
dc_voltage_source = Simulink.Parameter(48, Unit="V")  % DC Voltage Source
inertia_load = Simulink.Parameter(0.1, Unit="kg*m*m")  % Inertia of the load attached to the motor