% Simulink data dictionary model4_sample_times.sldd

pwm_powerstage_ts = Simulink.Parameter(2.0e-5, Unit="s")  % Sampling time for PWM power stage. It is derived from sampling rate which is 50kHz.
current_con_ts = Simulink.Parameter(4.0e-5, Unit="s")  % Sampling time for current control loop. It is derived from sampling rate which is 25kHz.
velocity_con_ts = Simulink.Parameter(0.0004, Unit="s")  % Sampling time for velocity control loop. It is derived from sampling rate which is 2.5kHz.
position_con_ts = Simulink.Parameter(0.0004, Unit="s")  % Sampling time for position control loop. It is derived from sampling rate which is 2.5kHz.