% Simulink data dictionary model4_rot_motor_data.sldd

rot_motor_P_rotorJ = Simulink.Parameter(6.5e-5, Unit="kg*m*m")  % Rotor inertia in rotary motor Maxon ECDT85
rot_motor_P_statorLd = Simulink.Parameter(0.0001835, Unit="H")  % Stator d-axis inductance in rotary motor Maxon ECDT85
rot_motor_P_statorLq = Simulink.Parameter(0.0001835, Unit="H")  % Stator q-axis inductance in rotary motor Maxon ECDT85
rot_motor_P_statorR = Simulink.Parameter(0.0785, Unit="Ω")  % Stator resistance per phase in rotary motor Maxon ECDT85
rot_motor_P_torqueK = Simulink.Parameter(0.134, Unit="N*m/A")  % Torque constant in rotary motor Maxon ECDT85
rot_motor_P_pole_pairs = Simulink.Parameter(10)  % Number of pole pairs in rotary motor Maxon ECDT85